# Grasshopper definition treeHandler_performance_test.gh (Grasshopper 1.0.7)

# ----
# Many-to-One Function
panel = Panel("50")
sqgrid = Square(Plane=PlaneXY(0, 0, 0), Size=1, ExtentX=panel, ExtentY=panel)  # -> Cells, Points
pop2d = Populate2D(Region=sqgrid.Cells, Count="3", Seed=1)
viewer = ParamViewer(pop2d)

# ----
# One-to-Many Function
panel_2 = Panel("1 To 5")
sqgrid_2 = Square(Plane=PlaneXY(0, 0, 0), Size="2", ExtentX="50", ExtentY="50")  # -> Cells, Points
lng = ListLength(List=sqgrid_2.Points)
random = Random(Range=panel_2, Number=lng, Seed=2)
int = Integer(random)
cir = Circle(Plane=sqgrid_2.Points, Radius=1)
viewer_2 = ParamViewer(cir)
viewer_3 = ParamViewer(int)

# ----
# One-to-One Function
panel_3 = Panel("50")
# TreeHandler Performance Test
# Author: Vincent Mai
# Version: 0.6.0
sqgrid_3 = Square(Plane=PlaneXY(0, 0, 0), Size=1, ExtentX=panel_3, ExtentY=panel_3)  # -> Cells, Points
lng_2 = ListLength(List=sqgrid_3.Points)
random_2 = Random(Range=Domain(0, 0.5), Number=lng_2, Seed=2)
num = Number(random_2)
viewer_4 = ParamViewer(sqgrid_3.Points)
viewer_5 = ParamViewer(num)

# ---- group: item loop
python = GhPythonScript(c=cir, n=int)  # -> out, a; disabled
# ---------- python: Python ----------
__author__ = "Vincent Mai"
__version__ = "2021.03.15"

import rhinoscriptsyntax as rs
import Rhino.Geometry as rg

a = rs.DivideCurve(c, n)
# ---------- end python ----------

# ---- group: tree loop
python_2 = GhPythonScript(c=cir, n=int)  # -> out, a; inputs c: tree, n: tree; disabled
# ---------- python_2: Python ----------
__author__ = "Vincent Mai"
__version__ = "2021.03.17"

import rhinoscriptsyntax as rs
import Rhino.Geometry as rg
import Grasshopper.DataTree as DataTree

a = DataTree[object]()

for i in range(c.BranchCount):
    for k, (cj, nj) in enumerate(zip(c.Branch(i), n.Branch(i))):
        result = rs.DivideCurve(cj, nj)
        a.AddRange(result, n.Path(i).AppendElement(k))
# ---------- end python_2 ----------

# ---- group: tree loop parallel
python_3 = GhPythonScript(c=cir, n=int)  # -> out, a; inputs c: tree, n: tree; disabled
# ---------- python_3: Python ----------
__author__ = "Vincent Mai"
__version__ = "2021.03.17"

from ghpythonlib import parallel as ghp
import rhinoscriptsyntax as rs
import Rhino.Geometry as rg
import Grasshopper.DataTree as DataTree

def divideCurve(args):
    return rs.DivideCurve(*args)

a = DataTree[object]()

argsList = [zip(ci, ni) for ci, ni in zip(c.Branches, n.Branches)]
resultList = [ghp.run(divideCurve, args) for args in argsList]

for i, result in enumerate(resultList):
    for j, item in enumerate(result):
        a.AddRange(item, n.Path(i).AppendElement(j))
# ---------- end python_3 ----------

# ---- group: TreeHandler
python_4 = GhPythonScript(c=cir, n=int)  # -> out, a; inputs c: tree, n: tree; disabled
# ---------- python_4: Python ----------
__author__ = "Vincent Mai"
__version__ = "2021.03.15"

from ghpythonutil.treehandler import TreeHandler
import Rhino.Geometry as rg
import rhinoscriptsyntax as rs

@TreeHandler
def divideCurve(c, n, access=["item", "item"]):
    return rs.DivideCurve(c, n)

a = divideCurve(c, n)
# ---------- end python_4 ----------

# ---- group: GH DivideCurve
divide = DivideCurve(Curve=cir, Count=int, Kinks=False)  # -> Points, Tangents, Parameters; disabled

# ---- group: item loop
python_5 = GhPythonScript(v=pop2d)  # -> out, a; inputs v: list; disabled
# ---------- python_5: Python ----------
__author__ = "Vincent Mai"
__version__ = "2021.03.15"

import rhinoscriptsyntax as rs
import Rhino.Geometry as rg

a = []
a.append(rg.Polyline(v))
# ---------- end python_5 ----------

# ---- group: tree loop
python_6 = GhPythonScript(v=pop2d)  # -> out, a; inputs v: tree; disabled
# ---------- python_6: Python ----------
__author__ = "Vincent Mai"
__version__ = "2021.03.17"

import rhinoscriptsyntax as rs
import Rhino.Geometry as rg
import Grasshopper.DataTree as DataTree

a = DataTree[object]()

for i in range(v.BranchCount):
    arg = v.Branch(i)
    a.Add(rg.Polyline(arg), v.Path(i))
# ---------- end python_6 ----------

# ---- group: tree loop parallel
python_7 = GhPythonScript(v=pop2d)  # -> out, a; inputs v: tree; disabled
# ---------- python_7: Python ----------
__author__ = "Vincent Mai"
__version__ = "2021.03.17"

import rhinoscriptsyntax as rs
import Rhino.Geometry as rg
import Grasshopper.DataTree as DataTree
from ghpythonlib import parallel as ghp

def polyline(args):
    return rg.Polyline(args)

a = DataTree[object]()
args = [vList for vList in v.Branches]
result = ghp.run(polyline, args)

for i in range(v.BranchCount):
    a.Add(result[i], v.Path(i))
# ---------- end python_7 ----------

# ---- group: TreeHandler
python_8 = GhPythonScript(v=pop2d)  # -> out, a; inputs v: tree; disabled
# ---------- python_8: Python ----------
__author__ = "Vincent Mai"
__version__ = "2021.03.15"

from ghpythonutil.treehandler import TreeHandler
import rhinoscriptsyntax as rs
import Rhino.Geometry as rg

@TreeHandler
def polyline(v, access=["list"]):
    return rg.Polyline(v)

a = polyline(v)
# ---------- end python_8 ----------

# ---- group: item loop
python_9 = GhPythonScript(p=sqgrid_3.Points, r=num)  # -> out, a; disabled
# ---------- python_9: Python ----------
__author__ = "Vincent Mai"
__version__ = "2021.03.15"

import rhinoscriptsyntax as rs
import Rhino.Geometry as rg

a = rg.Circle(p, r)
# ---------- end python_9 ----------

# ---- group: tree loop
python_10 = GhPythonScript(p=sqgrid_3.Points, r=num)  # -> out, a; inputs p: tree, r: tree; disabled
# ---------- python_10: Python ----------
__author__ = "Vincent Mai"
__version__ = "2021.03.17"

import rhinoscriptsyntax as rs
import Rhino.Geometry as rg
import Grasshopper.DataTree as DataTree

a = DataTree[object]()

for i in range(p.BranchCount):
    for pi, ri in zip(p.Branch(i), r.Branch(i)):
        a.Add(rg.Circle(pi, ri), r.Path(i))
# ---------- end python_10 ----------

# ---- group: tree loop parallel
python_11 = GhPythonScript(p=sqgrid_3.Points, r=num)  # -> out, a; inputs p: tree, r: tree; disabled
# ---------- python_11: Python ----------
__author__ = "Vincent Mai"
__version__ = "2021.03.17"

import rhinoscriptsyntax as rs
import Rhino.Geometry as rg
import Grasshopper.DataTree as DataTree
from ghpythonlib import parallel as ghp

def circle(args):
    return rg.Circle(*args)

a = DataTree[object]()
for i in range(p.BranchCount):
    args = zip(p.Branch(i), r.Branch(i))
    a.AddRange(ghp.run(circle, args), r.Path(i))
# ---------- end python_11 ----------

# ---- group: TreeHandler
python_12 = GhPythonScript(p=sqgrid_3.Points, r=num)  # -> out, a; inputs p: tree, r: tree; disabled
# ---------- python_12: Python ----------
__author__ = "Vincent Mai"
__version__ = "2021.03.15"

from ghpythonutil.treehandler import TreeHandler
import rhinoscriptsyntax as rs
import Rhino.Geometry as rg

@TreeHandler
def circle(p, r, access=["item", "item"]):
    return rg.Circle(p, r)

a = circle(p, r)
# ---------- end python_12 ----------

# ---- group: GH Polyline
pline = PolyLine(Vertices=pop2d, Closed=False)  # disabled

# ---- group: GH Circle
# Note:
# To see component runtime,
# ensure that "Menu" -> "Display" ->
# "Canvas Widgets" -> "Profiler"
# is turned on.
# 
# To run modules, drag to selct them,
# right click on any empty space on
# canvas and select "Enable".
cir_2 = Circle(Plane=sqgrid_3.Points, Radius=num)  # disabled
