# Grasshopper definition treehandler_point_attractor_tutorial.gh (Grasshopper 1.0.7)

# ---- group: Moves Attractors
md_slider = MDSlider(
    SliderMode=0,
    slider_value=Point(0.3934709933, 0.5766597159, 0.5),
    x_domain=Domain(-12, 12),
    y_domain=Domain(-12, 12),
    z_domain=Domain(0, 1))
md_slider_2 = MDSlider(
    SliderMode=0,
    slider_value=Point(0.2770424044, 0.2323085196, 0.5),
    x_domain=Domain(-12, 12),
    y_domain=Domain(-12, 12),
    z_domain=Domain(0, 1))
md_slider_3 = MDSlider(
    SliderMode=0,
    slider_value=Point(0.4296118624, 0.7859457063, 0.5),
    x_domain=Domain(-12, 12),
    y_domain=Domain(-12, 12),
    z_domain=Domain(0, 1))
md_slider_4 = MDSlider(
    SliderMode=0,
    slider_value=Point(0.5872595215, 0.5136057536, 0.5),
    x_domain=Domain(-12, 12),
    y_domain=Domain(-12, 12),
    z_domain=Domain(0, 1))

# ----
# TreeHandler Tutorial
# Author: Vincent Mai
# Version: 0.6.0
# A Simple Task
pt = ConstructPoint(XCoordinate=0, YCoordinate=0, ZCoordinate=0)
panel = Panel("""1
2
3""")
python = GhPythonScript(base=pt, radius=panel)  # -> out, a
# ---------- python: Python ----------
__author__ = "Vincent Mai"
__version__ = "2021.03.19"

import rhinoscriptsyntax as rs
import Rhino.Geometry as rg

def standardCone(base, radius):
    """Returns a standard conic surface on a XY plane
    where its radius equals its height"""
    apex = rs.PointAdd(base, rg.Vector3d(0, 0, radius))
    return rs.AddCone(base, apex, radius)
    
a = standardCone(base, radius)
# ---------- end python ----------

# ---- group: grid of 4 attractors
point = Point(Tree({0;0;1}: [Point(7.5, 7.5, 0), Point(7.5, 17.5, 0)], {0;0;3}: [Point(17.5, 7.5, 0), Point(17.5, 17.5, 0)]))

# ----
# A More Complex Task
panel_2 = Panel("5")
entwine = Entwine(Branch00=[md_slider_2, md_slider], Branch01=[md_slider_4, md_slider_3], FlattenInputs=True)
sqgrid = Square(Plane=PlaneXY(0, 0, 0), Size=panel_2, ExtentX=panel_2, ExtentY=panel_2)  # -> Cells, Points
division = Division(A=panel_2, B="2")
move = Move(Geometry=point, Motion=entwine)  # -> Geometry, Transform
python_2 = GhPythonScript(base=sqgrid.Points, radius=division, attractor=move.Geometry)  # -> out, a; inputs base: tree, radius: tree, attractor: tree
# ---------- python_2: Python ----------
__author__ = "Vincent Mai"
__version__ = "2021.03.19"

from Grasshopper import DataTree
from Grasshopper.Kernel.Data import GH_Path
from ghpythonutil.treehandler import TreeHandler
import rhinoscriptsyntax as rs
import Rhino.Geometry as rg
import math

def standardCone(base, radius):
    """Returns a standard conic surface on a XY plane
    where its radius equals its height"""
    apex = rs.PointAdd(base, rg.Vector3d(0, 0, radius))
    return rs.AddCone(base, apex, radius)

def makeQuadrants(ptGrid):
    """Divide point grid into four quadrants"""
    result = DataTree[object]()
    div = int(math.sqrt(ptGrid.DataCount / 4))
    for i, branch in enumerate(ptGrid.Branches):
        for j, item in enumerate(branch):
            result.Add(item, GH_Path(0, i//div, j//div))
    return result
    
def dist(pt1, pt2, cutoff=15):
    """Returns the distance between two points.
    Returns cutoff if the distance exceeds it."""
    return min(rs.Distance(pt1, pt2), cutoff)
    
def scale(scalar, val, bounds):
    """Returns a new value scaled by the scalar,
    but capped within bounds"""
    result = scalar*val
    lower, upper = bounds
    return max(min(result, upper), lower)

# split base and attractors into quadrants
# in essence modifying Data Tree topology
base = makeQuadrants(base)
attractor = makeQuadrants(attractor)

@TreeHandler
def main(base, radius, attractor, factor=0.1,
         access=["item", "item", "item"]):
    scalar = dist(base, attractor) * factor
    radius = scale(scalar, radius, bounds=(0.1, radius))
    return standardCone(base, radius)

a = main(base, radius, attractor)

print("Input Data Trees Topology")
for arg in (base, radius, attractor):
    print(arg.TopologyDescription)

print("Output Data Trees Topology")
print(a.TopologyDescription)
# ---------- end python_2 ----------

geo = Geometry(sqgrid.Cells)
